# Grasshopper definition Algorithm_AB.ghx (Grasshopper 0.9.76)

# ----
# Point grid
number_slider = Slider(0, range=0..100)  # disabled
number_slider_2 = Slider(1, range=0..1)  # disabled
number_slider_3 = Slider(10, range=0..10)  # disabled
series = Series(Start=number_slider, Step=number_slider_2, Count=number_slider_3)  # disabled
unit_y = UnitY(Factor=series)  # disabled
unit_x = UnitX(Factor=series)  # disabled
cross_reference = CrossReference(ListListA=unit_x, ListListB=unit_y, CrossMode=1)  # -> ListListA, ListListB; disabled
addition = Addition(A=cross_reference.ListListA, B=cross_reference.ListListB)  # disabled
point = Point(Point(0, 0, 0))  # disabled
move = Move(Geometry=point, Motion=addition)  # -> Geometry, Transform; disabled

# ----
# Creates subset of surfaces from input curves
reduction_floor_1 = Slider(7, range=0..10)
reduction_floor_2 = Slider(7, range=0..10)
seed = Slider(55, range=0..100)
floor_height = Slider(7, range=0..100)
curve = Curve([<curve referenced from the Rhino model> x11])
panel = Panel(curve)
unit_z = UnitZ(Factor=floor_height)
random_reduce = RandomReduce(List=flatten(curve), Reduction=reduction_floor_1, Seed=seed)
move_2 = Move(Geometry=random_reduce, Motion=unit_z)  # -> Geometry, Transform
random_reduce_2 = RandomReduce(List=flatten(move_2.Geometry), Reduction=reduction_floor_2, Seed=seed)
merge = Merge(Data1=random_reduce, Data2=move_2.Geometry)

# ----
# Random boxes reduced
number_slider_4 = Slider(2, range=0..10)  # disabled
number_slider_5 = Slider(5, range=0..10)  # disabled
number_slider_6 = Slider(6, range=0..10)  # disabled
number_slider_7 = Slider(10, range=0..10)  # disabled
center_box = CenterBox(Base=PlaneXY(0, 0, 0), X=number_slider_4, Y=number_slider_4, Z=number_slider_4)  # disabled
number_slider_8 = Slider(248, range=0..1000)  # disabled
box_array = BoxArray(
    Geometry=center_box,
    Cell={Plane=PlaneXY(0, 0, 0), X=Domain(0, 10), Y=Domain(0, 5), Z=Domain(0, 2)},
    XCount=number_slider_6,
    YCount=number_slider_5,
    ZCount=number_slider_7)  # -> Geometry, Transform; disabled
list_length = ListLength(List=box_array.Geometry)  # disabled
random_reduce_3 = RandomReduce(List=box_array.Geometry, Reduction=number_slider_8, Seed=1)  # disabled
subtraction = Subtraction(A=list_length, B=number_slider_8)  # disabled
panel_2 = Panel(box_array.Geometry)  # disabled
panel_3 = Panel(subtraction)  # disabled

# ----
# Count connected surfaces
solid_union = SolidUnion(Breps=random_reduce)
merge_faces = MergeFaces(Brep=solid_union)  # -> Breps, Before, After
list_length_2 = ListLength(List=merge_faces.Breps)
panel_4 = Panel(list_length_2)

offset = Offset(Curve=merge, Distance=Slider(-3, range=-20..100), Plane=PlaneXY(0, 0, 0), Corners=1)
division_amount = Slider(5, range=0..10)
divide_surfaces = DivideSurfaces(curve=merge, surface=merge, B=division_amount, B_2=Slider(5, range=0..10))

number_slider_9 = Slider(9, range=0..100)
surface = Surface(<surface referenced from the Rhino model>)
divide_surface = DivideSurface(Surface=surface, UCount=number_slider_9, VCount=number_slider_9)  # -> Points, Normals, Parameters
random_reduce_4 = RandomReduce(List=flatten(divide_surface.Points), Reduction=Slider(90, range=0..1000), Seed=1)
interpolate = Interpolate(Vertices=random_reduce_4, Degree=3, Periodic=False, KnotStyle=1)  # -> Curve, Length, Domain

extrude = Extrude(Base=divide_surfaces, Direction=unit_z)
cap_holes = CapHoles(Brep=extrude)  # -> flatten(Brep)
curve_2 = Curve(<curve referenced from the Rhino model>)

# ----
# Intersection Brep | Curve
brep_curve = BrepCurve(Brep=cap_holes, Curve=interpolate.Curve)  # -> Curves, Points
list_length_3 = ListLength(List=brep_curve.Curves)
number = Number(1)
smaller_than = SmallerThan(FirstNumber=list_length_3, SecondNumber=number)  # -> flatten(SmallerThan), OrEqualTo
sift_pattern = SiftPattern(List=cap_holes, SiftPattern=smaller_than.SmallerThan)  # -> Output0, Output1

brep = Brep(sift_pattern.Output1)
brep_2 = Brep(sift_pattern.Output0)
solid_union_2 = SolidUnion(Breps=brep_2)
merge_faces_2 = MergeFaces(Brep=solid_union_2)  # -> Breps, Before, After
custom_preview = CustomPreview(Geometry=merge_faces_2.Breps, Shader=ColourSwatch(SwatchColor=RGB(0, 255, 51)))

# ==== cluster DivideSurfaces
curve = ClusterInput()
number = Number(1)
number_2 = Number(0)
B = ClusterInput()
B_2 = ClusterInput()
surface = ClusterInput()

# ----
# Divide surface into equal sized subsurfaces
explode = Explode(Curve=curve, Recursive=True)  # -> Segments, Vertices
list_item = ListItem(List=explode.Segments, Index=number, Wrap=True)
list_item_2 = ListItem(List=explode.Segments, Index=number_2, Wrap=True)
length = Length(Curve=list_item_2)
length_2 = Length(Curve=list_item)
division = Division(A=length, B=B)  # -> flatten(Result)
division_2 = Division(A=length_2, B=B_2)  # -> flatten(Result)
mesh_surface = MeshSurface(Surface=surface, UCount=division, VCount=division_2, Overhang=True, Equalize=False)
face_boundaries = FaceBoundaries(Mesh=mesh_surface)

boundaries = ClusterOutput(face_boundaries)
