# Grasshopper definition Algorithm_AB2.ghx (Grasshopper 0.9.76)

number_slider = Slider(10, range=0..10)  # disabled
number_slider_2 = Slider(0, range=0..10)  # disabled
number_slider_3 = Slider(50, range=0..100)  # disabled
number_slider_4 = Slider(21, range=0..100)  # disabled
number_slider_5 = Slider(15, range=0..100)  # disabled
number_slider_6 = Slider(44, range=0..100)  # disabled
construct_point = ConstructPoint(XCoordinate=number_slider, YCoordinate=number_slider_3, ZCoordinate=number_slider_5)  # disabled
construct_point_2 = ConstructPoint(XCoordinate=number_slider_2, YCoordinate=number_slider_4, ZCoordinate=number_slider_6)  # disabled
number_slider_7 = Slider(4, range=0..10)  # disabled
line = Line(StartPoint=construct_point, EndPoint=construct_point_2)  # disabled
divide_curve = DivideCurve(Curve=line, Count=number_slider_7, Kinks=False)  # -> Points, Tangents, Parameters; disabled
number_slider_8 = Slider(3, range=0..10)  # disabled
number_slider_9 = Slider(5.2, range=0..100)  # disabled
number_slider_10 = Slider(3, range=0..100)  # disabled
number_slider_11 = Slider(4, range=0..100)  # disabled
list_item = ListItem(List=divide_curve.Points, Index=number_slider_8, Wrap=True)  # disabled
center_box = CenterBox(Base=list_item, X=number_slider_9, Y=number_slider_11, Z=number_slider_10)  # disabled

number_slider_12 = Slider(2, range=0..10)  # disabled
number_slider_13 = Slider(6, range=0..10)  # disabled
number_slider_14 = Slider(6, range=0..10)  # disabled
number_slider_15 = Slider(10, range=0..10)  # disabled
center_box_2 = CenterBox(Base=PlaneXY(0, 0, 0), X=number_slider_12, Y=number_slider_12, Z=number_slider_12)  # disabled
number_slider_16 = Slider(200, range=0..1000)  # disabled
box_array = BoxArray(
    Geometry=center_box_2,
    Cell={Plane=PlaneXY(0, 0, 0), X=Domain(0, 10), Y=Domain(0, 5), Z=Domain(0, 2)},
    XCount=number_slider_14,
    YCount=number_slider_13,
    ZCount=number_slider_15)  # -> Geometry, Transform; disabled
list_length = ListLength(List=box_array.Geometry)  # disabled
random_reduce = RandomReduce(List=box_array.Geometry, Reduction=number_slider_16, Seed=1)  # disabled
subtraction = Subtraction(A=list_length, B=number_slider_16)  # disabled
panel = Panel(box_array.Geometry)  # disabled
panel_2 = Panel(subtraction)  # disabled

# ----
# Creates subset of surfaces from input curves
floor_height = Slider(10, range=0..100)
curve = Curve([<curve referenced from the Rhino model> x10])
panel_3 = Panel(curve)
seed = Slider(52, range=0..100)
unit_z = UnitZ(Factor=floor_height)
random_reduce_2 = RandomReduce(List=flatten(curve), Reduction=Slider(3, range=0..10), Seed=seed)
move = Move(Geometry=random_reduce_2, Motion=unit_z)  # -> Geometry, Transform
random_reduce_3 = RandomReduce(List=flatten(move.Geometry), Reduction=Slider(7, range=0..10), Seed=seed)
merge = Merge(Data1=random_reduce_2, Data2=random_reduce_3)

series = Series(Start=Slider(0, range=0..100), Step=Slider(1, range=0..1), Count=Slider(10, range=0..10))
unit_y = UnitY(Factor=series)
unit_x = UnitX(Factor=series)
cross_reference = CrossReference(ListListA=unit_x, ListListB=unit_y, CrossMode=1)  # -> ListListA, ListListB
point = Point(Point(0, 0, 0))
addition = Addition(A=cross_reference.ListListA, B=cross_reference.ListListB)
move_2 = Move(Geometry=point, Motion=addition)  # -> Geometry, Transform

extrude_linear = ExtrudeLinear(OrientationP=PlaneXY(0, 0, 0))
domain = Domain(Domain(7, 14))
random = Random(Range=domain, Number=Slider(7, range=0..10), Seed=Slider(20, range=0..100))
graft_tree = GraftTree(Tree=random, IncludeEmptyLists=True, IncludeNullItems=True)
division_amount = Slider(5, range=0..10)
divide_surfaces = DivideSurfaces(curve=merge, surface=merge, B=division_amount, B_2=division_amount)
unit_z_2 = UnitZ(Factor=graft_tree)
extrude = Extrude(Base=divide_surfaces, Direction=unit_z_2)
# Ideas for mergin the unit boxes into larger spaces
# 
# 1: Create a graph structure with unit
# boxes as vertices and whether they are
#  next to each other as edge, then cluster
# the graph into rooms.
# 
# 2. Place points that 'fight' over area
# (Voronoi?) Then square off the areas
# and create the rooms
cap_holes = CapHoles(Brep=extrude)  # -> flatten(Brep)
list_item_2 = ListItem(List=cap_holes, Index=Slider(40, range=0..100), Wrap=True)
curve_2 = Curve(<curve referenced from the Rhino model>)

# ----
# Intersection Brep | Curve
brep_curve = BrepCurve(Brep=cap_holes, Curve=curve_2)  # -> Curves, Points; disabled
number = Number(1)  # disabled
list_length_2 = ListLength(List=brep_curve.Curves)  # disabled
smaller_than = SmallerThan(FirstNumber=list_length_2, SecondNumber=number)  # -> flatten(SmallerThan), OrEqualTo; disabled
sift_pattern = SiftPattern(List=cap_holes, SiftPattern=smaller_than.SmallerThan)  # -> Output0, Output1; disabled

brep_brep = BrepBrep(BrepA=cap_holes, BrepB=cap_holes)  # -> Curves, Points
graft_tree_2 = GraftTree(Tree=cap_holes, IncludeEmptyLists=True, IncludeNullItems=True)
sift_pattern_2 = SiftPattern(List=graft_tree_2, SiftPattern=brep_brep.Curves)  # -> Output0, Output1
panel_4 = Panel(graft_tree_2)
brep = Brep(sift_pattern.Output1)  # disabled

# ==== cluster DivideSurfaces
curve = ClusterInput()
number = Number(1)
number_2 = Number(0)
B = ClusterInput()
B_2 = ClusterInput()
surface = ClusterInput()

# ----
# Divide surface into equal sized subsurfaces
explode = Explode(Curve=curve, Recursive=True)  # -> Segments, Vertices
list_item = ListItem(List=explode.Segments, Index=number, Wrap=True)
list_item_2 = ListItem(List=explode.Segments, Index=number_2, Wrap=True)
length = Length(Curve=list_item_2)
length_2 = Length(Curve=list_item)
division = Division(A=length, B=B)  # -> flatten(Result)
division_2 = Division(A=length_2, B=B_2)  # -> flatten(Result)
mesh_surface = MeshSurface(Surface=surface, UCount=division, VCount=division_2, Overhang=True, Equalize=False)
face_boundaries = FaceBoundaries(Mesh=mesh_surface)

boundaries = ClusterOutput(face_boundaries)
