# Grasshopper definition Algorithm_AB3.ghx (Grasshopper 0.9.76)
# plug-ins: Python Interpreter

number_slider = Slider(10, range=0..10)  # disabled
number_slider_2 = Slider(0, range=0..10)  # disabled
number_slider_3 = Slider(50, range=0..100)  # disabled
number_slider_4 = Slider(21, range=0..100)  # disabled
number_slider_5 = Slider(15, range=0..100)  # disabled
number_slider_6 = Slider(44, range=0..100)  # disabled
construct_point = ConstructPoint(XCoordinate=number_slider, YCoordinate=number_slider_3, ZCoordinate=number_slider_5)  # disabled
construct_point_2 = ConstructPoint(XCoordinate=number_slider_2, YCoordinate=number_slider_4, ZCoordinate=number_slider_6)  # disabled
number_slider_7 = Slider(4, range=0..10)  # disabled
line = Line(StartPoint=construct_point, EndPoint=construct_point_2)  # disabled
divide_curve = DivideCurve(Curve=line, Count=number_slider_7, Kinks=False)  # -> Points, Tangents, Parameters; disabled
number_slider_8 = Slider(3, range=0..10)  # disabled
number_slider_9 = Slider(5.2, range=0..100)  # disabled
number_slider_10 = Slider(3, range=0..100)  # disabled
number_slider_11 = Slider(4, range=0..100)  # disabled
list_item = ListItem(List=divide_curve.Points, Index=number_slider_8, Wrap=True)  # disabled
center_box = CenterBox(Base=list_item, X=number_slider_9, Y=number_slider_11, Z=number_slider_10)  # disabled

number_slider_12 = Slider(2, range=0..10)  # disabled
number_slider_13 = Slider(6, range=0..10)  # disabled
number_slider_14 = Slider(6, range=0..10)  # disabled
number_slider_15 = Slider(10, range=0..10)  # disabled
center_box_2 = CenterBox(Base=PlaneXY(0, 0, 0), X=number_slider_12, Y=number_slider_12, Z=number_slider_12)  # disabled
number_slider_16 = Slider(200, range=0..1000)  # disabled
box_array = BoxArray(
    Geometry=center_box_2,
    Cell={Plane=PlaneXY(0, 0, 0), X=Domain(0, 10), Y=Domain(0, 5), Z=Domain(0, 2)},
    XCount=number_slider_14,
    YCount=number_slider_13,
    ZCount=number_slider_15)  # -> Geometry, Transform; disabled
list_length = ListLength(List=box_array.Geometry)  # disabled
random_reduce = RandomReduce(List=box_array.Geometry, Reduction=number_slider_16, Seed=1)  # disabled
subtraction = Subtraction(A=list_length, B=number_slider_16)  # disabled
panel = Panel(box_array.Geometry)  # disabled
panel_2 = Panel(subtraction)  # disabled

# ----
# Creates subset of surfaces from input curves
floor_height = Slider(10, range=0..100)
curve = Curve([<curve referenced from the Rhino model> x10])
panel_3 = Panel(curve)
seed = Slider(45, range=0..100)
unit_z = UnitZ(Factor=floor_height)
random_reduce_2 = RandomReduce(List=flatten(curve), Reduction=Slider(3, range=0..10), Seed=seed)
move = Move(Geometry=random_reduce_2, Motion=unit_z)  # -> Geometry, Transform
random_reduce_3 = RandomReduce(List=flatten(move.Geometry), Reduction=Slider(7, range=0..10), Seed=seed)
merge = Merge(Data1=random_reduce_2, Data2=random_reduce_3)

number_slider_17 = Slider(10, range=0..10)  # disabled
number_slider_18 = Slider(1, range=0..1)  # disabled
number_slider_19 = Slider(0, range=0..100)  # disabled
series = Series(Start=number_slider_19, Step=number_slider_18, Count=number_slider_17)  # disabled
unit_y = UnitY(Factor=series)  # disabled
unit_x = UnitX(Factor=series)  # disabled
cross_reference = CrossReference(ListListA=unit_x, ListListB=unit_y, CrossMode=1)  # -> ListListA, ListListB; disabled
point = Point(Point(0, 0, 0))  # disabled
addition = Addition(A=cross_reference.ListListA, B=cross_reference.ListListB)  # disabled
move_2 = Move(Geometry=point, Motion=addition)  # -> Geometry, Transform; disabled

extrude_linear = ExtrudeLinear(OrientationP=PlaneXY(0, 0, 0))

# ----
# Pick randomly from set of heights
number_slider_20 = Slider(10, range=0..10)
random = Random(Range=Domain(0, 1), Number=number_slider_20, Seed=2, Integers=True)
height_values = Integer([10, 14])
list_item_2 = ListItem(List=height_values, Index=random, Wrap=True)
graft_tree = GraftTree(Tree=list_item_2, IncludeEmptyLists=True, IncludeNullItems=True)

division_amount = Slider(5, range=0..10)
divide_surfaces = DivideSurfaces(curve=merge, surface=merge, B=division_amount, B_2=division_amount)
unit_z_2 = UnitZ(Factor=graft_tree)
extrude = Extrude(Base=divide_surfaces, Direction=unit_z_2)
collision_many_many = CollisionManyMany(Colliders=extrude)  # -> Collision, Indices; disabled

# ----
# Indices of breps of 'important points'
brep = Brep(extrude)
startpoint = Point(Point(51.33898358, -92.62155196, 3.343424246))
startpoint_2 = Point(Point(38.63329456, -131.04581, 3.343424246))
startpoint_3 = Point(Point(108.3044605, -108.6734879, 3.343424246))
endpoint = Point(Point(50.17162935, -156.6598276, 0.7096957161))
endpoint_2 = Point(Point(70.52303666, -152.5321402, 0.7096957161))
endpoint_3 = Point(Point(99.15811423, -156.0869, 0.7096957161))
first_intersecting_brep = FirstIntersectingBrep(brep=brep, point=startpoint, end_point=endpoint)
first_intersecting_brep_2 = FirstIntersectingBrep(brep=brep, point=startpoint_2, end_point=endpoint_2)
first_intersecting_brep_3 = FirstIntersectingBrep(brep=brep, point=startpoint_3, end_point=endpoint_3)
brep_2 = Brep(first_intersecting_brep)
brep_3 = Brep(first_intersecting_brep_2)
brep_4 = Brep(first_intersecting_brep_3)
item_index = ItemIndex(List=flatten(brep), Item=flatten(brep_2))
item_index_2 = ItemIndex(List=flatten(brep), Item=flatten(brep_3))
item_index_3 = ItemIndex(List=flatten(brep), Item=flatten(brep_4))
clean_tree = CleanTree(RemoveNulls=True, RemoveInvalid=True, RemoveEmpty=False, Tree=item_index)
clean_tree_2 = CleanTree(RemoveNulls=True, RemoveInvalid=True, RemoveEmpty=False, Tree=item_index_2)
clean_tree_3 = CleanTree(RemoveNulls=True, RemoveInvalid=True, RemoveEmpty=False, Tree=item_index_3)
merge_2 = Merge(Data1=clean_tree, Data2=clean_tree_2, Data3=clean_tree_3)

cap_holes = CapHoles(Brep=extrude)  # -> flatten(Brep)
curve_2 = Curve(<curve referenced from the Rhino model>)

# ----
# Intersection Brep | Curve
brep_curve = BrepCurve(Brep=cap_holes, Curve=curve_2)  # -> Curves, Points
number = Number(1)
list_length_2 = ListLength(List=brep_curve.Curves)
smaller_than = SmallerThan(FirstNumber=list_length_2, SecondNumber=number)  # -> flatten(SmallerThan), OrEqualTo
sift_pattern = SiftPattern(List=cap_holes, SiftPattern=smaller_than.SmallerThan)  # -> Output0, Output1

brep_self_intersect = PythonScript(Brep=flatten(extrude))  # -> out, result; inputs Brep: list
# ---------- brep_self_intersect: Python ----------
import rhinoscriptsyntax as rs
edgesFound = []
for i, BrepA in enumerate(Brep):
    for j, BrepB in enumerate(Brep):
        if(rs.IntersectBreps(BrepA, BrepB)):
            edgesFound.append((i, j))
edges = dict()
for i in range(len(Brep)):
    edges[i] = set()
for edge in edgesFound:
    edges[edge[0]].add(edge[1])
    edges[edge[1]].add(edge[0])
for i, edge in enumerate(edges):
    edges[edge].discard(i) #Remove own value from own intersection set
result = [edges]
print(edges)
# ---------- end brep_self_intersect ----------

# ----
# Random Path
number_slider_21 = Slider(10, range=0..10)  # disabled
number_slider_22 = Slider(18, range=0..100)  # disabled

py_bfs_cycle = PythonScript(edgeAdjList=brep_self_intersect.result, points=merge_2)  # -> out, path; inputs edgeAdjList: list, points: list
# ---------- py_bfs_cycle: Python ----------
#Goes through list of points and gets 
#shortest path cycle from point to next point
edges = edgeAdjList[0]
##
#Breadth First Search
def BFS(edges, start, end):
    queue = [[start]]
    visited = set()

    while queue:
        # Gets the first path in the queue
        path = queue.pop(0)

        # Gets the last node in the path
        vertex = path[-1]

        # Checks if we got to the end
        if vertex == end:
            return path
        # We check if the current node is already in the visited nodes set in order not to recheck it
        elif vertex not in visited:
            # enumerate all adjacent nodes, construct a new path and push it into the queue
            for adjacent in edges.get(vertex, []):
                new_path = list(path)
                new_path.append(adjacent)
                queue.append(new_path)

            # Mark the vertex as visited
            visited.add(vertex)

path = BFS(edges, points[0], points[1])
path = path + BFS(edges, points[1], points[2])
path = path + BFS(edges, points[2], points[0])
# ---------- end py_bfs_cycle ----------

random_path = PythonScript(edges=brep_self_intersect.result, length=number_slider_21, seed=number_slider_22)  # -> out, path, leftover; inputs edges: list
# ---------- random_path: Python ----------
import random
import copy
random.seed(seed)
i = length #Preferred path length
edgeAdjList = copy.deepcopy(edges[0])
nodeAmount = len(edgeAdjList)

## Creates random path given adjacency list of edges
def createPath(edges, length):
    i = length
    node = random.choice(edges.keys())#Pick initial random node
    path = [] #Resulting path
    path.append(node)
    while(i>0):
        if(len(edges[node])<1):#Check whether node still has edges
            print("Node has no edges")
            break
        newNode = random.sample(edges[node], 1)[0]#Pick random edge of node
        #Remove references to old node
        del edges[node]
        for edge in edges:
            edges[edge].discard(node)
        #Update node and add to path
        node = newNode
        path.append(node)
        i = i-1
    return path

path = createPath(edgeAdjList, i)
leftover = [edgeAdjList]
# ---------- end random_path ----------
list_item_3 = ListItem(List=cap_holes, Index=random_path.path, Wrap=True)  # disabled
colour_swatch = ColourSwatch(SwatchColor=RGB(255, 255, 255))  # disabled
custom_preview = CustomPreview(Geometry=list_item_3, Shader=colour_swatch)  # disabled

random_path_2 = PythonScript(edges=random_path.leftover, length=number_slider_21, seed=number_slider_22)  # -> out, path, leftover; inputs edges: list; disabled; same code as random_path
colour_swatch_2 = ColourSwatch(SwatchColor=RGB(255, 0, 0))  # disabled
list_item_4 = ListItem(List=cap_holes, Index=random_path_2.path, Wrap=True)  # disabled
custom_preview_2 = CustomPreview(Geometry=list_item_4, Shader=colour_swatch_2)  # disabled

random_path_3 = PythonScript(edges=random_path_2.leftover, length=number_slider_21, seed=number_slider_22)  # -> out, path, leftover; inputs edges: list; disabled; same code as random_path
colour_swatch_3 = ColourSwatch(SwatchColor=RGB(117, 133, 16))  # disabled
list_item_5 = ListItem(List=cap_holes, Index=random_path_3.path, Wrap=True)  # disabled
custom_preview_3 = CustomPreview(Geometry=list_item_5, Shader=colour_swatch_3)  # disabled

brep_5 = Brep(sift_pattern.Output1)
py_divide_path = PythonScript(path=py_bfs_cycle.path, amount=Slider(4, range=0..10))  # -> out, sections; inputs path: list
# ---------- py_divide_path: Python ----------
from collections import OrderedDict
#Remove duplicates
uniques = list(OrderedDict.fromkeys(path))
chunkSize = int(len(uniques)/amount)

def chunks(l, n):
    for i in range(0, len(l), n):
        yield l[i:i+n]

sections = list(chunks(uniques, chunkSize))
print(uniques)
print(sections)

#Divide into equal sections
#Flood fill equally
# ---------- end py_divide_path ----------
# Divide path into sections and floodfill
list_item_6 = ListItem(List=cap_holes, Index=py_bfs_cycle.path, Wrap=True)
panel_4 = Panel(py_divide_path.sections)
custom_preview_4 = CustomPreview(
    Geometry=list_item_6,
    Shader={ambient=RGB(0, 0, 0), diffuse=RGB(255, 105, 180), emission=RGB(76, 32, 54), shine=0.5, specular=RGB(255, 255, 255), transparency=0})
py_floodfill = PythonScript(edgeAdjList=brep_self_intersect.result, sections=py_divide_path.sections)  # -> out, a; inputs edgeAdjList: list, sections: list
# ---------- py_floodfill: Python ----------
import random
import copy
##
# Remove nodes already in a section from adjList
# For each section, floodfll once repeatedly.

#Merge nodes in sections
edges = copy.deepcopy(edgeAdjList[0])
sectionEdges = dict()
for i in range(len(sections)):
    sectionEdges[i] = set()
print(sections)
for i, section in enumerate(sections):
    print(section)
    for node in section:
        for edge in edges[node]:
            sectionEdges[i].add(edge)
        del edges[node]
        for edge in edges:
            edges[edge].discard(node)
print sectionEdges

print("Starting while loop")
while edges:
    for i, section in enumerate(sections):
        #Remove edges to self
        for node in section:
            sectionEdges[i].discard(node)
        #Pick an adjacent node
        print(len(sectionEdges[i]))
        newNode = random.sample(sectionEdges[i], 1)[0]
        #Add it to section, remove from all section edges sets and edges
        #section.append(newNode)
        for j, section in enumerate(sections):
            sectionEdges[j].discard(newNode)
        #All neighbours of new Node
        print(len(edges[newNode]))
        for edge in edges[newNode]:
            sectionEdges[i].add(edge)

        del edges[newNode]
        for edge in edges:
            edges[edge].discard(newNode)
# ---------- end py_floodfill ----------
panel_5 = Panel(py_divide_path.out)
panel_6 = Panel(py_floodfill.out)

# ==== cluster DivideSurfaces
curve = ClusterInput()
number = Number(1)
number_2 = Number(0)
B = ClusterInput()
B_2 = ClusterInput()
surface = ClusterInput()

# ----
# Divide surface into equal sized subsurfaces
explode = Explode(Curve=curve, Recursive=True)  # -> Segments, Vertices
list_item = ListItem(List=explode.Segments, Index=number, Wrap=True)
list_item_2 = ListItem(List=explode.Segments, Index=number_2, Wrap=True)
length = Length(Curve=list_item_2)
length_2 = Length(Curve=list_item)
division = Division(A=length, B=B)  # -> flatten(Result)
division_2 = Division(A=length_2, B=B_2)  # -> flatten(Result)
mesh_surface = MeshSurface(Surface=surface, UCount=division, VCount=division_2, Overhang=True, Equalize=False)
face_boundaries = FaceBoundaries(Mesh=mesh_surface)

boundaries = ClusterOutput(face_boundaries)

# ==== cluster FirstIntersectingBrep
brep = ClusterInput()
end_point = ClusterInput()
point = ClusterInput()
brep_2 = Brep(brep)
point_2 = Point(point)
line = Line(StartPoint=point_2, EndPoint=end_point)
brep_line = BrepLine(Brep=brep_2, Line=line, LimitToFirst=False)  # -> Curves, Points
closest_point = ClosestPoint(Point=point_2, Cloud=flatten(brep_line.Points))  # -> ClosestPoint, CPIndex, Distance
item_index = ItemIndex(List=brep_line.Points, Item=closest_point.ClosestPoint)
larger_than = LargerThan(FirstNumber=item_index, SecondNumber=Slider(0, range=0..100))  # -> LargerThan, OrEqualTo
graft_tree = GraftTree(Tree=brep_2, IncludeEmptyLists=True, IncludeNullItems=True)
sift_pattern = SiftPattern(List=graft_tree, SiftPattern=larger_than.OrEqualTo)  # -> Output0, Output1
brep_3 = Brep(sift_pattern.Output1)
brep_4 = ClusterOutput(brep_3)
