# Grasshopper definition Algorithm_AB4.ghx (Grasshopper 0.9.76)
# plug-ins: Python Interpreter

number_slider = Slider(10, range=0..10)  # disabled
number_slider_2 = Slider(0, range=0..10)  # disabled
number_slider_3 = Slider(50, range=0..100)  # disabled
number_slider_4 = Slider(21, range=0..100)  # disabled
number_slider_5 = Slider(15, range=0..100)  # disabled
number_slider_6 = Slider(44, range=0..100)  # disabled
construct_point = ConstructPoint(XCoordinate=number_slider, YCoordinate=number_slider_3, ZCoordinate=number_slider_5)  # disabled
construct_point_2 = ConstructPoint(XCoordinate=number_slider_2, YCoordinate=number_slider_4, ZCoordinate=number_slider_6)  # disabled
number_slider_7 = Slider(4, range=0..10)  # disabled
line = Line(StartPoint=construct_point, EndPoint=construct_point_2)  # disabled
divide_curve = DivideCurve(Curve=line, Count=number_slider_7, Kinks=False)  # -> Points, Tangents, Parameters; disabled
number_slider_8 = Slider(3, range=0..10)  # disabled
number_slider_9 = Slider(5.2, range=0..100)  # disabled
number_slider_10 = Slider(3, range=0..100)  # disabled
number_slider_11 = Slider(4, range=0..100)  # disabled
list_item = ListItem(List=divide_curve.Points, Index=number_slider_8, Wrap=True)  # disabled
center_box = CenterBox(Base=list_item, X=number_slider_9, Y=number_slider_11, Z=number_slider_10)  # disabled

number_slider_12 = Slider(2, range=0..10)  # disabled
number_slider_13 = Slider(6, range=0..10)  # disabled
number_slider_14 = Slider(6, range=0..10)  # disabled
number_slider_15 = Slider(10, range=0..10)  # disabled
center_box_2 = CenterBox(Base=PlaneXY(0, 0, 0), X=number_slider_12, Y=number_slider_12, Z=number_slider_12)  # disabled
number_slider_16 = Slider(200, range=0..1000)  # disabled
box_array = BoxArray(
    Geometry=center_box_2,
    Cell={Plane=PlaneXY(0, 0, 0), X=Domain(0, 10), Y=Domain(0, 5), Z=Domain(0, 2)},
    XCount=number_slider_14,
    YCount=number_slider_13,
    ZCount=number_slider_15)  # -> Geometry, Transform; disabled
list_length = ListLength(List=box_array.Geometry)  # disabled
random_reduce = RandomReduce(List=box_array.Geometry, Reduction=number_slider_16, Seed=1)  # disabled
subtraction = Subtraction(A=list_length, B=number_slider_16)  # disabled
panel = Panel(box_array.Geometry)  # disabled
panel_2 = Panel(subtraction)  # disabled

# ----
# Creates subset of surfaces from input curves
floor_height = Slider(10, range=0..100)
curve = Curve([<curve referenced from the Rhino model> x10])
panel_3 = Panel(curve)
seed = Slider(45, range=0..100)
unit_z = UnitZ(Factor=floor_height)
random_reduce_2 = RandomReduce(List=flatten(curve), Reduction=Slider(3, range=0..10), Seed=seed)
move = Move(Geometry=random_reduce_2, Motion=unit_z)  # -> Geometry, Transform
random_reduce_3 = RandomReduce(List=flatten(move.Geometry), Reduction=Slider(7, range=0..10), Seed=seed)
merge = Merge(Data1=random_reduce_2, Data2=random_reduce_3)

number_slider_17 = Slider(10, range=0..10)  # disabled
number_slider_18 = Slider(1, range=0..1)  # disabled
number_slider_19 = Slider(0, range=0..100)  # disabled
series = Series(Start=number_slider_19, Step=number_slider_18, Count=number_slider_17)  # disabled
unit_y = UnitY(Factor=series)  # disabled
unit_x = UnitX(Factor=series)  # disabled
cross_reference = CrossReference(ListListA=unit_x, ListListB=unit_y, CrossMode=1)  # -> ListListA, ListListB; disabled
point = Point(Point(0, 0, 0))  # disabled
addition = Addition(A=cross_reference.ListListA, B=cross_reference.ListListB)  # disabled
move_2 = Move(Geometry=point, Motion=addition)  # -> Geometry, Transform; disabled

extrude_linear = ExtrudeLinear(OrientationP=PlaneXY(0, 0, 0))
domain = Domain(Domain(7, 14))
random = Random(Range=domain, Number=Slider(7, range=0..10), Seed=Slider(20, range=0..100))
division_amount = Slider(7, range=0..10)
graft_tree = GraftTree(Tree=random, IncludeEmptyLists=True, IncludeNullItems=True)
divide_surfaces = DivideSurfaces(curve=merge, surface=merge, B=division_amount, B_2=division_amount)
unit_z_2 = UnitZ(Factor=graft_tree)
# Ideas for mergin the unit boxes into larger spaces
# 
# 1: Create a graph structure with unit
# boxes as vertices and whether they are
#  next to each other as edge, then cluster
# the graph into rooms.
# 
# 2. Place points that 'fight' over area
# (Voronoi?) Then square off the areas
# and create the rooms
extrude = Extrude(Base=divide_surfaces, Direction=unit_z_2)
list_item_2 = ListItem(List=flatten(extrude), Index=Slider(35, range=0..100), Wrap=True)
curve_2 = Curve(<curve referenced from the Rhino model>)
cap_holes = CapHoles(Brep=extrude)  # -> flatten(Brep)
brep_self_intersect = PythonScript(Brep=flatten(extrude))  # -> out, result; inputs Brep: list
# ---------- brep_self_intersect: Python ----------
import rhinoscriptsyntax as rs
edgesFound = []
for i, BrepA in enumerate(Brep):
    for j, BrepB in enumerate(Brep):
        if(rs.IntersectBreps(BrepA, BrepB)):
            edgesFound.append((i, j))
edges = dict()
for i in range(len(Brep)):
    edges[i] = set()
for edge in edgesFound:
    edges[edge[0]].add(edge[1])
    edges[edge[1]].add(edge[0])
for i, edge in enumerate(edges):
    edges[edge].discard(i) #Remove own value from own intersection set
result = [edges]
print(edges)
# ---------- end brep_self_intersect ----------
number_slider_20 = Slider(17, range=0..100)
number_slider_21 = Slider(73, range=0..100)
number_slider_22 = Slider(78, range=0..100)
number_slider_23 = Slider(5, range=1..10)
number_slider_24 = Slider(47, range=0..100)

# ----
# Intersection Brep | Curve
brep_curve = BrepCurve(Brep=cap_holes, Curve=curve_2)  # -> Curves, Points
number = Number(1)
list_length_2 = ListLength(List=brep_curve.Curves)
smaller_than = SmallerThan(FirstNumber=list_length_2, SecondNumber=number)  # -> flatten(SmallerThan), OrEqualTo
sift_pattern = SiftPattern(List=cap_holes, SiftPattern=smaller_than.SmallerThan)  # -> Output0, Output1

random_path = PythonScript(edges=brep_self_intersect.result, length=Slider(6, range=1..10), seed=number_slider_21)  # -> out, path, leftover; inputs edges: list
# ---------- random_path: Python ----------
import random
import copy
random.seed(seed)
i = length #Preferred path length
edgeAdjList = copy.deepcopy(edges[0])
nodeAmount = len(edgeAdjList)

## Creates random path given adjacency list of edges
def createPath(edges, length):
    i = length
    node = random.choice(edges.keys())#Pick initial random node
    path = [] #Resulting path
    path.append(node)
    while(i>0):
        if(len(edges[node])<1):#Check whether node still has edges
            print("Node has no edges")
            break
        newNode = random.sample(edges[node], 1)[0]#Pick random edge of node
        #Remove references to old node
        del edges[node]
        for edge in edges:
            edges[edge].discard(node)
        #Update node and add to path
        node = newNode
        path.append(node)
        i = i-1
    return path

path = createPath(edgeAdjList, i)
leftover = [edgeAdjList]
# ---------- end random_path ----------
list_item_3 = ListItem(List=cap_holes, Index=random_path.path, Wrap=True)
custom_preview = CustomPreview(Geometry=list_item_3, Shader=ColourSwatch(SwatchColor=RGB(255, 255, 255)))

random_path_2 = PythonScript(edges=random_path.leftover, length=Slider(5, range=1..10), seed=number_slider_20)  # -> out, path, leftover; inputs edges: list; same code as random_path
list_item_4 = ListItem(List=cap_holes, Index=random_path_2.path, Wrap=True)
custom_preview_2 = CustomPreview(Geometry=list_item_4, Shader=ColourSwatch(SwatchColor=RGB(255, 0, 0)))

random_path_3 = PythonScript(edges=random_path_2.leftover, length=number_slider_23, seed=number_slider_22)  # -> out, path, leftover; inputs edges: list; same code as random_path
list_item_5 = ListItem(List=cap_holes, Index=random_path_3.path, Wrap=True)
custom_preview_3 = CustomPreview(Geometry=list_item_5, Shader=ColourSwatch(SwatchColor=RGB(255, 251, 0)))

random_path_4 = PythonScript(edges=random_path_3.leftover, length=Slider(5, range=1..10), seed=number_slider_24)  # -> out, path, leftover; inputs edges: list; same code as random_path
list_item_6 = ListItem(List=cap_holes, Index=random_path_4.path, Wrap=True)
custom_preview_4 = CustomPreview(Geometry=list_item_6, Shader=ColourSwatch(SwatchColor=RGB(16, 74, 232)))

brep = Brep(sift_pattern.Output1)
area = Area(Geometry=list_item_4)  # -> Area, Centroid
area_2 = Area(Geometry=list_item_5)  # -> Area, Centroid
area_3 = Area(Geometry=list_item_3)  # -> Area, Centroid
area_4 = Area(Geometry=list_item_6)  # -> Area, Centroid
galapagos = Galapagos(fitness=num, gene=[number_slider_21, number_slider_20, number_slider_22, number_slider_24])
pt = Point(area.Centroid)
pt_2 = Point(area_3.Centroid)
distance = Distance(PointA=pt_2, PointB=pt)
pt_3 = Point(area_2.Centroid)
distance_2 = Distance(PointA=pt_2, PointB=pt_3)
pt_4 = Point(area_4.Centroid)
distance_3 = Distance(PointA=pt_2, PointB=pt_4)
mass_addition = MassAddition(Input=distance_2)  # -> Result, PartialResults
mass_addition_2 = MassAddition(Input=distance)  # -> Result, PartialResults
list_length_3 = ListLength(List=distance)
mass_addition_3 = MassAddition(Input=distance_3)  # -> Result, PartialResults
list_length_4 = ListLength(List=distance_3)
list_length_5 = ListLength(List=distance_2)
division = Division(A=Slider(1, range=0..1), B=list_length_3)
division_2 = Division(A=mass_addition_2.Result, B=list_length_3)
division_3 = Division(A=mass_addition_3.Result, B=list_length_4)
division_4 = Division(A=mass_addition.Result, B=list_length_5)
division_5 = Division(A=Slider(1, range=0..1), B=list_length_4)
division_6 = Division(A=Slider(1, range=0..1), B=list_length_5)
galapagos_2 = Galapagos(gene=[number_slider_23, number_slider_22])
merge_2 = Merge(Data1=division, Data2=division_6, Data3=division_5)
merge_3 = Merge(Data1=division_2, Data2=division_4, Data3=division_3)
mass_addition_4 = MassAddition(Input=merge_2)  # -> Result, PartialResults
mass_addition_5 = MassAddition(Input=merge_3)  # -> Result, PartialResults
multiplication = Multiplication(A=mass_addition_4.Result, B=Slider(5, range=0..10))
addition_2 = Addition(A=mass_addition_5.Result, B=multiplication)
num = Number(addition_2)

# ==== cluster DivideSurfaces
curve = ClusterInput()
number = Number(1)
number_2 = Number(0)
B = ClusterInput()
B_2 = ClusterInput()
surface = ClusterInput()

# ----
# Divide surface into equal sized subsurfaces
explode = Explode(Curve=curve, Recursive=True)  # -> Segments, Vertices
list_item = ListItem(List=explode.Segments, Index=number, Wrap=True)
list_item_2 = ListItem(List=explode.Segments, Index=number_2, Wrap=True)
length = Length(Curve=list_item_2)
length_2 = Length(Curve=list_item)
division = Division(A=length, B=B)  # -> flatten(Result)
division_2 = Division(A=length_2, B=B_2)  # -> flatten(Result)
mesh_surface = MeshSurface(Surface=surface, UCount=division, VCount=division_2, Overhang=True, Equalize=False)
face_boundaries = FaceBoundaries(Mesh=mesh_surface)

boundaries = ClusterOutput(face_boundaries)
