# Grasshopper definition Algorithm_MP7.ghx (Grasshopper 0.9.76)
# plug-ins: Python Interpreter

number_slider = Slider(10, range=0..10)  # disabled
number_slider_2 = Slider(0, range=0..10)  # disabled
number_slider_3 = Slider(50, range=0..100)  # disabled
number_slider_4 = Slider(21, range=0..100)  # disabled
number_slider_5 = Slider(15, range=0..100)  # disabled
number_slider_6 = Slider(44, range=0..100)  # disabled
construct_point = ConstructPoint(XCoordinate=number_slider, YCoordinate=number_slider_3, ZCoordinate=number_slider_5)  # disabled
construct_point_2 = ConstructPoint(XCoordinate=number_slider_2, YCoordinate=number_slider_4, ZCoordinate=number_slider_6)  # disabled
number_slider_7 = Slider(4, range=0..10)  # disabled
line = Line(StartPoint=construct_point, EndPoint=construct_point_2)  # disabled
divide_curve = DivideCurve(Curve=line, Count=number_slider_7, Kinks=False)  # -> Points, Tangents, Parameters; disabled
number_slider_8 = Slider(3, range=0..10)  # disabled
number_slider_9 = Slider(5.2, range=0..100)  # disabled
number_slider_10 = Slider(3, range=0..100)  # disabled
number_slider_11 = Slider(4, range=0..100)  # disabled
list_item = ListItem(List=divide_curve.Points, Index=number_slider_8, Wrap=True)  # disabled
center_box = CenterBox(Base=list_item, X=number_slider_9, Y=number_slider_11, Z=number_slider_10)  # disabled

number_slider_12 = Slider(2, range=0..10)  # disabled
number_slider_13 = Slider(6, range=0..10)  # disabled
number_slider_14 = Slider(6, range=0..10)  # disabled
number_slider_15 = Slider(10, range=0..10)  # disabled
center_box_2 = CenterBox(Base=PlaneXY(0, 0, 0), X=number_slider_12, Y=number_slider_12, Z=number_slider_12)  # disabled
number_slider_16 = Slider(200, range=0..1000)  # disabled
box_array = BoxArray(
    Geometry=center_box_2,
    Cell={Plane=PlaneXY(0, 0, 0), X=Domain(0, 10), Y=Domain(0, 5), Z=Domain(0, 2)},
    XCount=number_slider_14,
    YCount=number_slider_13,
    ZCount=number_slider_15)  # -> Geometry, Transform; disabled
list_length = ListLength(List=box_array.Geometry)  # disabled
random_reduce = RandomReduce(List=box_array.Geometry, Reduction=number_slider_16, Seed=1)  # disabled
subtraction = Subtraction(A=list_length, B=number_slider_16)  # disabled
panel = Panel(box_array.Geometry)  # disabled
panel_2 = Panel(subtraction)  # disabled

# ----
# Creates subset of surfaces from input curves
number_slider_17 = Slider(3, range=0..10)
seed = Slider(32, range=0..100)
floor_height = Slider(10, range=0..100)
curve = Curve([<curve referenced from the Rhino model> x10])
panel_3 = Panel(curve)
unit_z = UnitZ(Factor=floor_height)
random_reduce_2 = RandomReduce(List=flatten(curve), Reduction=number_slider_17, Seed=seed)
move = Move(Geometry=random_reduce_2, Motion=unit_z)  # -> Geometry, Transform
random_reduce_3 = RandomReduce(List=flatten(move.Geometry), Reduction=Slider(7, range=0..10), Seed=seed)  # disabled
merge = Merge(Data1=random_reduce_2, Data2=random_reduce_3)

number_slider_18 = Slider(10, range=0..10)  # disabled
number_slider_19 = Slider(1, range=0..1)  # disabled
number_slider_20 = Slider(0, range=0..100)  # disabled
series = Series(Start=number_slider_20, Step=number_slider_19, Count=number_slider_18)  # disabled
unit_y = UnitY(Factor=series)  # disabled
unit_x = UnitX(Factor=series)  # disabled
cross_reference = CrossReference(ListListA=unit_x, ListListB=unit_y, CrossMode=1)  # -> ListListA, ListListB; disabled
point = Point(Point(0, 0, 0))  # disabled
addition = Addition(A=cross_reference.ListListA, B=cross_reference.ListListB)  # disabled
move_2 = Move(Geometry=point, Motion=addition)  # -> Geometry, Transform; disabled

extrude_linear = ExtrudeLinear(OrientationP=PlaneXY(0, 0, 0))
number_slider_21 = Slider(7, range=0..100)
num = Number(Slider(8.1, range=0..15))
num_2 = Number(Slider(15.4, range=0..20))
merge_2 = Merge(Data1=num_2, Data2=num)
random = Random(Range=number_slider_21, Number=number_slider_21, Seed=Slider(78, range=0..100))
item = ListItem(List=merge_2, Index=random, Wrap=True)
division_amount = Slider(8, range=0..10)
graft_tree = GraftTree(Tree=item, IncludeEmptyLists=True, IncludeNullItems=True)
divide_surfaces = DivideSurfaces(curve=merge, surface=merge, B=division_amount, B_2=division_amount)
area = Area(Geometry=divide_surfaces)  # -> Area, Centroid
unit_z_2 = UnitZ(Factor=graft_tree)
# Ideas for mergin the unit boxes into larger spaces
# 
# 1: Create a graph structure with unit
# boxes as vertices and whether they are
#  next to each other as edge, then cluster
# the graph into rooms.
# 
# 2. Place points that 'fight' over area
# (Voronoi?) Then square off the areas
# and create the rooms
mass_addition = MassAddition(Input=flatten(area.Area))  # -> Result, PartialResults
extrude = Extrude(Base=divide_surfaces, Direction=unit_z_2)
subtraction_2 = Subtraction(A=mass_addition.Result, B=Slider(2000, range=0..10000))
galapagos = Galapagos(fitness=absolute, gene=[number_slider_17, seed])
absolute = Absolute(Value=subtraction_2)
list_item_2 = ListItem(List=flatten(extrude), Index=Slider(50, range=0..100), Wrap=True)
curve_2 = Curve(<curve referenced from the Rhino model>)
cap_holes = CapHoles(Brep=extrude)  # -> flatten(Brep)
brep_self_intersect = PythonScript(Brep=flatten(extrude))  # -> out, result; inputs Brep: list
# ---------- brep_self_intersect: Python ----------
import rhinoscriptsyntax as rs
edgesFound = []
for i, BrepA in enumerate(Brep):
    for j, BrepB in enumerate(Brep):
        if(rs.IntersectBreps(BrepA, BrepB)):
            edgesFound.append((i, j))
edges = dict()
for i in range(len(Brep)):
    edges[i] = set()
for edge in edgesFound:
    edges[edge[0]].add(edge[1])
    edges[edge[1]].add(edge[0])
for i, edge in enumerate(edges):
    edges[edge].discard(i) #Remove own value from own intersection set
result = [edges]
print(edges)
# ---------- end brep_self_intersect ----------

# ----
# Intersection Brep | Curve
brep_curve = BrepCurve(Brep=cap_holes, Curve=curve_2)  # -> Curves, Points
number = Number(1)
list_length_2 = ListLength(List=brep_curve.Curves)
smaller_than = SmallerThan(FirstNumber=list_length_2, SecondNumber=number)  # -> flatten(SmallerThan), OrEqualTo
sift_pattern = SiftPattern(List=cap_holes, SiftPattern=smaller_than.SmallerThan)  # -> Output0, Output1

brep = Brep(sift_pattern.Output1)
crv = Curve(<curve referenced from the Rhino model>)
galapagos_2 = Galapagos(fitness=addition_9, gene=[number_slider_23, number_slider_22, number_slider_24, number_slider_25])

number_slider_22 = Slider(34, range=0..100)
number_slider_23 = Slider(63, range=0..100)
number_slider_24 = Slider(56, range=0..100)
number_slider_25 = Slider(31, range=0..100)

random_path = PythonScript(edges=brep_self_intersect.result, length=Slider(6, range=1..20), seed=number_slider_23)  # -> out, path, leftover; inputs edges: list
# ---------- random_path: Python ----------
import random
import copy
random.seed(seed)
i = length #Preferred path length
edgeAdjList = copy.deepcopy(edges[0])
nodeAmount = len(edgeAdjList)

## Creates random path given adjacency list of edges
def createPath(edges, length):
    i = length
    node = random.choice(edges.keys())#Pick initial random node
    path = [] #Resulting path
    path.append(node)
    while(i>0):
        if(len(edges[node])<1):#Check whether node still has edges
            print("Node has no edges")
            break
        newNode = random.sample(edges[node], 1)[0]#Pick random edge of node
        #Remove references to old node
        del edges[node]
        for edge in edges:
            edges[edge].discard(node)
        #Update node and add to path
        node = newNode
        path.append(node)
        i = i-1
    del edges[node]
    for edge in edges:
        edges[edge].discard(node)
    return path

path = createPath(edgeAdjList, i)
leftover = [edgeAdjList]
# ---------- end random_path ----------
list_item_3 = ListItem(List=cap_holes, Index=random_path.path, Wrap=True)
custom_preview = CustomPreview(Geometry=list_item_3, Shader=ColourSwatch(SwatchColor=RGB(255, 255, 255)))

random_path_2 = PythonScript(edges=random_path.leftover, length=Slider(8, range=1..20), seed=number_slider_22)  # -> out, path, leftover; inputs edges: list; same code as random_path
list_item_4 = ListItem(List=cap_holes, Index=random_path_2.path, Wrap=True)
custom_preview_2 = CustomPreview(Geometry=list_item_4, Shader=ColourSwatch(SwatchColor=RGB(255, 0, 0)))

random_path_3 = PythonScript(edges=random_path_2.leftover, length=Slider(6, range=1..20), seed=number_slider_24)  # -> out, path, leftover; inputs edges: list; same code as random_path
list_item_5 = ListItem(List=cap_holes, Index=random_path_3.path, Wrap=True)
custom_preview_3 = CustomPreview(Geometry=list_item_5, Shader=ColourSwatch(SwatchColor=RGB(255, 251, 0)))

random_path_4 = PythonScript(edges=random_path_3.leftover, length=Slider(5, range=1..20), seed=number_slider_25)  # -> out, path, leftover; inputs edges: list; same code as random_path
list_item_6 = ListItem(List=cap_holes, Index=random_path_4.path, Wrap=True)
custom_preview_4 = CustomPreview(Geometry=list_item_6, Shader=ColourSwatch(SwatchColor=RGB(16, 74, 232)))

python_script = PythonScript(edgeAdjList=random_path_4.leftover)  # -> out, a; inputs edgeAdjList: list
# ---------- python_script: Python ----------
a= []
for key in edgeAdjList[0].keys():
    a.append(key)
# ---------- end python_script ----------
list_item_7 = ListItem(List=cap_holes, Index=python_script.a, Wrap=True)
custom_preview_5 = CustomPreview(Geometry=list_item_7, Shader=ColourSwatch(SwatchColor=RGBA(7, 212, 0, 133)))

area_2 = Area(Geometry=list_item_7)  # -> Area, Centroid
pt = Point(area_2.Centroid)
crv_cp = CurveClosestPoint(Point=pt, Curve=crv)  # -> Point, Parameter, Distance

area_3 = Area(Geometry=list_item_5)  # -> Area, Centroid
area_4 = Area(Geometry=list_item_4)  # -> Area, Centroid
area_5 = Area(Geometry=list_item_6)  # -> Area, Centroid
area_6 = Area(Geometry=list_item_3)  # -> Area, Centroid
pt_2 = Point(area_3.Centroid)
pt_3 = Point(area_5.Centroid)
pt_4 = Point(area_6.Centroid)
pt_5 = Point(area_4.Centroid)

lng = ListLength(List=area_4.Area)
lng_2 = ListLength(List=area_6.Area)
lng_3 = ListLength(List=area_3.Area)
lng_4 = ListLength(List=area_5.Area)
addition_2 = Addition(A=lng_2, B=lng)
addition_3 = Addition(A=lng_3, B=lng_4)
addition_4 = Addition(A=addition_2, B=addition_3)

dist = Distance(PointA=pt_4, PointB=pt_5)
dist_2 = Distance(PointA=pt_4, PointB=pt_2)
dist_3 = Distance(PointA=pt_4, PointB=pt_3)
num_3 = Number(dist)
num_4 = Number(dist_2)
num_5 = Number(dist_3)

larger = LargerThan(FirstNumber=num_3, SecondNumber=Slider(0, range=0..1))  # -> LargerThan, OrEqualTo
larger_2 = LargerThan(FirstNumber=num_4, SecondNumber=Slider(0, range=0..1))  # -> LargerThan, OrEqualTo
larger_3 = LargerThan(FirstNumber=num_5, SecondNumber=Slider(0, range=0..1))  # -> LargerThan, OrEqualTo

addition_5 = Addition(A=larger.LargerThan, B=larger_2.LargerThan)
addition_6 = Addition(A=addition_5, B=larger_3.LargerThan)
neg = Negative(Value=addition_6)

addition_7 = Addition(A=neg, B=crv_cp.Distance)

addition_8 = Addition(A=addition_4, B=neg)

addition_9 = Addition(A=addition_8, B=addition_7)

# ==== cluster DivideSurfaces
curve = ClusterInput()
number = Number(1)
number_2 = Number(0)
B = ClusterInput()
B_2 = ClusterInput()
surface = ClusterInput()

# ----
# Divide surface into equal sized subsurfaces
explode = Explode(Curve=curve, Recursive=True)  # -> Segments, Vertices
list_item = ListItem(List=explode.Segments, Index=number, Wrap=True)
list_item_2 = ListItem(List=explode.Segments, Index=number_2, Wrap=True)
length = Length(Curve=list_item_2)
length_2 = Length(Curve=list_item)
division = Division(A=length, B=B)  # -> flatten(Result)
division_2 = Division(A=length_2, B=B_2)  # -> flatten(Result)
mesh_surface = MeshSurface(Surface=surface, UCount=division, VCount=division_2, Overhang=True, Equalize=False)
face_boundaries = FaceBoundaries(Mesh=mesh_surface)

boundaries = ClusterOutput(face_boundaries)
