# Grasshopper definition Algorithm_MP_2.ghx (Grasshopper 0.9.76)

construct_point = ConstructPoint(XCoordinate=Slider(10, range=0..10), YCoordinate=Slider(50, range=0..100), ZCoordinate=Slider(15, range=0..100))
construct_point_2 = ConstructPoint(XCoordinate=Slider(0, range=0..10), YCoordinate=Slider(21, range=0..100), ZCoordinate=Slider(44, range=0..100))
line = Line(StartPoint=construct_point, EndPoint=construct_point_2)
divide_curve = DivideCurve(Curve=line, Count=Slider(4, range=0..10), Kinks=False)  # -> Points, Tangents, Parameters
list_item = ListItem(List=divide_curve.Points, Index=Slider(3, range=0..10), Wrap=True)
center_box = CenterBox(Base=list_item, X=Slider(5.2, range=0..100), Y=Slider(4, range=0..100), Z=Slider(3, range=0..100))

number_slider = Slider(2, range=0..10)
center_box_2 = CenterBox(Base=PlaneXY(0, 0, 0), X=number_slider, Y=number_slider, Z=number_slider)
number_slider_2 = Slider(200, range=0..1000)
box_array = BoxArray(
    Geometry=center_box_2,
    Cell={Plane=PlaneXY(0, 0, 0), X=Domain(0, 10), Y=Domain(0, 5), Z=Domain(0, 2)},
    XCount=Slider(6, range=0..10),
    YCount=Slider(6, range=0..10),
    ZCount=Slider(10, range=0..10))  # -> Geometry, Transform
list_length = ListLength(List=box_array.Geometry)
random_reduce = RandomReduce(List=box_array.Geometry, Reduction=number_slider_2, Seed=1)
subtraction = Subtraction(A=list_length, B=number_slider_2)
panel = Panel(box_array.Geometry)
panel_2 = Panel(subtraction)

# ----
# Creates subset of surfaces from input curves
floor_height = Slider(10, range=0..100)
curve = Curve([<curve referenced from the Rhino model> x10])
panel_3 = Panel(curve)
seed = Slider(60, range=0..100)
unit_z = UnitZ(Factor=floor_height)
random_reduce_2 = RandomReduce(List=flatten(curve), Reduction=Slider(3, range=0..10), Seed=seed)
move = Move(Geometry=random_reduce_2, Motion=unit_z)  # -> Geometry, Transform
random_reduce_3 = RandomReduce(List=flatten(move.Geometry), Reduction=Slider(7, range=0..10), Seed=seed)
merge = Merge(Data1=random_reduce_2, Data2=random_reduce_3)

series = Series(Start=Slider(0, range=0..100), Step=Slider(1, range=0..1), Count=Slider(10, range=0..10))
unit_y = UnitY(Factor=series)
unit_x = UnitX(Factor=series)
cross_reference = CrossReference(ListListA=unit_x, ListListB=unit_y, CrossMode=1)  # -> ListListA, ListListB
point = Point(Point(0, 0, 0))
addition = Addition(A=cross_reference.ListListA, B=cross_reference.ListListB)
move_2 = Move(Geometry=point, Motion=addition)  # -> Geometry, Transform

extrude_linear = ExtrudeLinear(OrientationP=PlaneXY(0, 0, 0))
domain = Domain(Domain(7, 14))
random = Random(Range=domain, Number=Slider(7, range=0..10), Seed=Slider(20, range=0..100))
graft_tree = GraftTree(Tree=random, IncludeEmptyLists=True, IncludeNullItems=True)
division_amount = Slider(5, range=0..10)
unit_z_2 = UnitZ(Factor=graft_tree)
divide_surfaces = DivideSurfaces(curve=merge, surface=merge, B=division_amount, B_2=division_amount)
extrude = Extrude(Base=divide_surfaces, Direction=unit_z_2)
cap_holes = CapHoles(Brep=extrude)  # -> flatten(Brep)
curve_2 = Curve(<curve referenced from the Rhino model>)

# ----
# Intersection Brep | Curve
brep_curve = BrepCurve(Brep=cap_holes, Curve=curve_2)  # -> Curves, Points
number = Number(1)
list_length_2 = ListLength(List=brep_curve.Curves)
smaller_than = SmallerThan(FirstNumber=list_length_2, SecondNumber=number)  # -> flatten(SmallerThan), OrEqualTo
sift_pattern = SiftPattern(List=cap_holes, SiftPattern=smaller_than.SmallerThan)  # -> Output0, Output1

brep = Brep(sift_pattern.Output1)
split = SplitList(List=brep, Index=Slider(10, range=1..10))  # -> ListA, ListB
preview = CustomPreview(Geometry=split.ListB, Shader=ColourSwatch(SwatchColor=RGB(240, 59, 255)))
preview_2 = CustomPreview(Geometry=split.ListA, Shader=ColourSwatch(SwatchColor=RGB(47, 41, 255)))

# ==== cluster DivideSurfaces
curve = ClusterInput()
number = Number(1)
number_2 = Number(0)
B = ClusterInput()
B_2 = ClusterInput()
surface = ClusterInput()

# ----
# Divide surface into equal sized subsurfaces
explode = Explode(Curve=curve, Recursive=True)  # -> Segments, Vertices
list_item = ListItem(List=explode.Segments, Index=number, Wrap=True)
list_item_2 = ListItem(List=explode.Segments, Index=number_2, Wrap=True)
length = Length(Curve=list_item_2)
length_2 = Length(Curve=list_item)
division = Division(A=length, B=B)  # -> flatten(Result)
division_2 = Division(A=length_2, B=B_2)  # -> flatten(Result)
mesh_surface = MeshSurface(Surface=surface, UCount=division, VCount=division_2, Overhang=True, Equalize=False)
face_boundaries = FaceBoundaries(Mesh=mesh_surface)

boundaries = ClusterOutput(face_boundaries)
