# Grasshopper definition Algorithm_NN.gh (Grasshopper 0.9.76)

number_slider = Slider(2, range=0..10)  # disabled
number_slider_2 = Slider(10, range=0..10)  # disabled
number_slider_3 = Slider(6, range=0..10)  # disabled
number_slider_4 = Slider(6, range=0..10)  # disabled
center_box = CenterBox(Base=PlaneXY(0, 0, 0), X=number_slider, Y=number_slider, Z=number_slider)  # disabled
number_slider_5 = Slider(200, range=0..1000)  # disabled
box_array = BoxArray(
    Geometry=center_box,
    Cell={Plane=PlaneXY(0, 0, 0), X=Domain(0, 10), Y=Domain(0, 5), Z=Domain(0, 2)},
    XCount=number_slider_3,
    YCount=number_slider_4,
    ZCount=number_slider_2)  # -> Geometry, Transform; disabled
list_length = ListLength(List=box_array.Geometry)  # disabled
random_reduce = RandomReduce(List=box_array.Geometry, Reduction=number_slider_5, Seed=1)  # disabled
subtraction = Subtraction(A=list_length, B=number_slider_5)  # disabled
panel = Panel(box_array.Geometry)  # disabled
panel_2 = Panel(subtraction)  # disabled

number_slider_6 = Slider(10, range=0..10)  # disabled
number_slider_7 = Slider(0, range=0..10)  # disabled
number_slider_8 = Slider(50, range=0..100)  # disabled
number_slider_9 = Slider(21, range=0..100)  # disabled
number_slider_10 = Slider(15, range=0..100)  # disabled
number_slider_11 = Slider(44, range=0..100)  # disabled
construct_point = ConstructPoint(XCoordinate=number_slider_7, YCoordinate=number_slider_9, ZCoordinate=number_slider_11)  # disabled
construct_point_2 = ConstructPoint(XCoordinate=number_slider_6, YCoordinate=number_slider_8, ZCoordinate=number_slider_10)  # disabled
number_slider_12 = Slider(4, range=0..10)  # disabled
line = Line(StartPoint=construct_point_2, EndPoint=construct_point)  # disabled
divide_curve = DivideCurve(Curve=line, Count=number_slider_12, Kinks=False)  # -> Points, Tangents, Parameters; disabled
number_slider_13 = Slider(3, range=0..10)  # disabled
number_slider_14 = Slider(5.2, range=0..100)  # disabled
number_slider_15 = Slider(3, range=0..100)  # disabled
number_slider_16 = Slider(4, range=0..100)  # disabled
list_item = ListItem(List=divide_curve.Points, Index=number_slider_13, Wrap=True)  # disabled
center_box_2 = CenterBox(Base=list_item, X=number_slider_14, Y=number_slider_16, Z=number_slider_15)  # disabled

curve = Curve([<curve referenced from the Rhino model> x14])
unit_z = UnitZ(Factor=Slider(15, range=0..100))
panel_3 = Panel(curve)
extrude = Extrude(Base=curve, Direction=unit_z)
number_slider_17 = Slider(64, range=0..100)
random_reduce_2 = RandomReduce(List=flatten(extrude), Reduction=Slider(7, range=0..10), Seed=number_slider_17)
extrude_2 = Extrude(Base=random_reduce_2, Direction=unit_z)
move = Move(Geometry=extrude_2, Motion=unit_z)  # -> Geometry, Transform
random_reduce_3 = RandomReduce(List=flatten(move.Geometry), Reduction=Slider(4, range=0..10), Seed=number_slider_17)
merge = Merge(Data1=random_reduce_2, Data2=random_reduce_3)

number_slider_18 = Slider(10, range=0..10)  # disabled
number_slider_19 = Slider(5, range=0..10)  # disabled
range = Range(Domain=number_slider_19, Steps=number_slider_18)  # disabled
curve_2 = Curve([<curve referenced from the Rhino model> x11])
panel_4 = Panel(curve_2)
multiplication = Multiplication(A=Slider(2, range=1..10), B=Slider(2, range=0..10))
unit_z_2 = UnitZ(Factor=Slider(7.5, range=1..15))
random = Random(Range=range, Number=1, Seed=2)  # disabled
rectangle = Rectangle(Plane=PlaneXY(0, 0, 0), XSize=multiplication, YSize=multiplication, Radius=0)  # -> Rectangle, Length

series = Series(Start=Slider(0, range=0..100), Step=Slider(10, range=0..10), Count=Slider(19, range=0..100))
smaller = SmallerThan(FirstNumber=series, SecondNumber=Slider(50, range=0..100))  # -> SmallerThan, OrEqualTo

move_2 = Move(Geometry=curve_2, Motion=unit_z_2)  # -> Geometry, Transform
Z = UnitZ(Factor=random)  # disabled
extrude_3 = Extrude(Base=curve_2, Direction=unit_z_2)
box_rectangle = BoxRectangle(Rectangle=rectangle.Rectangle, Height=multiplication)
extrude_4 = Extrude(Base=move_2.Geometry, Direction=unit_z_2)
random_reduce_4 = RandomReduce(List=extrude_3, Reduction=Slider(5, range=1..10), Seed=Slider(35, range=1..50))
box_array_2 = BoxArray(
    Geometry=box_rectangle,
    Cell=box_rectangle,
    XCount=Slider(10, range=1..20),
    YCount=Slider(12, range=1..20),
    ZCount=Slider(4, range=1..10))  # -> Geometry, Transform
point = Point(<point referenced from the Rhino model>)
random_reduce_5 = RandomReduce(List=extrude_4, Reduction=Slider(5, range=1..10), Seed=Slider(12, range=1..25))  # -> graft(List)
move_3 = Move(Geometry=box_array_2.Geometry, Motion=point)  # -> Geometry, Transform
cap_holes = CapHoles(Brep=[random_reduce_5, random_reduce_4])
merge_2 = Merge(Data1=random_reduce_5, Data2=random_reduce_4, Data3=cap_holes)
panel_5 = Panel(random_reduce_5)
