# Grasshopper definition Grid Update.gh (Grasshopper 0.9.76)
# plug-ins: Python Interpreter

number_slider = Slider(10, range=0..10)  # disabled
number_slider_2 = Slider(0, range=0..10)  # disabled
number_slider_3 = Slider(50, range=0..100)  # disabled
number_slider_4 = Slider(21, range=0..100)  # disabled
number_slider_5 = Slider(15, range=0..100)  # disabled
number_slider_6 = Slider(44, range=0..100)  # disabled
construct_point = ConstructPoint(XCoordinate=number_slider, YCoordinate=number_slider_3, ZCoordinate=number_slider_5)  # disabled
construct_point_2 = ConstructPoint(XCoordinate=number_slider_2, YCoordinate=number_slider_4, ZCoordinate=number_slider_6)  # disabled
number_slider_7 = Slider(4, range=0..10)  # disabled
line = Line(StartPoint=construct_point, EndPoint=construct_point_2)  # disabled
divide_curve = DivideCurve(Curve=line, Count=number_slider_7, Kinks=False)  # -> Points, Tangents, Parameters; disabled
number_slider_8 = Slider(3, range=0..10)  # disabled
number_slider_9 = Slider(5.2, range=0..100)  # disabled
number_slider_10 = Slider(3, range=0..100)  # disabled
number_slider_11 = Slider(4, range=0..100)  # disabled
list_item = ListItem(List=divide_curve.Points, Index=number_slider_8, Wrap=True)  # disabled
center_box = CenterBox(Base=list_item, X=number_slider_9, Y=number_slider_11, Z=number_slider_10)  # disabled

number_slider_12 = Slider(2, range=0..10)  # disabled
number_slider_13 = Slider(6, range=0..10)  # disabled
number_slider_14 = Slider(6, range=0..10)  # disabled
number_slider_15 = Slider(10, range=0..10)  # disabled
center_box_2 = CenterBox(Base=PlaneXY(0, 0, 0), X=number_slider_12, Y=number_slider_12, Z=number_slider_12)  # disabled
number_slider_16 = Slider(200, range=0..1000)  # disabled
box_array = BoxArray(
    Geometry=center_box_2,
    Cell={Plane=PlaneXY(0, 0, 0), X=Domain(0, 10), Y=Domain(0, 5), Z=Domain(0, 2)},
    XCount=number_slider_14,
    YCount=number_slider_13,
    ZCount=number_slider_15)  # -> Geometry, Transform; disabled
list_length = ListLength(List=box_array.Geometry)  # disabled
random_reduce = RandomReduce(List=box_array.Geometry, Reduction=number_slider_16, Seed=1)  # disabled
subtraction = Subtraction(A=list_length, B=number_slider_16)  # disabled
panel = Panel(box_array.Geometry)  # disabled
panel_2 = Panel(subtraction)  # disabled

# ----
# Creates subset of surfaces from input curves
floor_height = Slider(10, range=0..100)
curve = Curve([<curve referenced from the Rhino model> x10])
panel_3 = Panel(curve)
seed = Slider(55, range=0..100)
unit_z = UnitZ(Factor=floor_height)
random_reduce_2 = RandomReduce(List=flatten(curve), Reduction=Slider(6, range=0..10), Seed=seed)
move = Move(Geometry=random_reduce_2, Motion=unit_z)  # -> Geometry, Transform
random_reduce_3 = RandomReduce(List=flatten(move.Geometry), Reduction=Slider(6, range=0..10), Seed=seed)
merge = Merge(Data1=random_reduce_2, Data2=random_reduce_3)

number_slider_17 = Slider(10, range=0..10)  # disabled
number_slider_18 = Slider(1, range=0..1)  # disabled
number_slider_19 = Slider(0, range=0..100)  # disabled
series = Series(Start=number_slider_19, Step=number_slider_18, Count=number_slider_17)  # disabled
unit_y = UnitY(Factor=series)  # disabled
unit_x = UnitX(Factor=series)  # disabled
cross_reference = CrossReference(ListListA=unit_x, ListListB=unit_y, CrossMode=1)  # -> ListListA, ListListB; disabled
point = Point(Point(0, 0, 0))  # disabled
addition = Addition(A=cross_reference.ListListA, B=cross_reference.ListListB)  # disabled
move_2 = Move(Geometry=point, Motion=addition)  # -> Geometry, Transform; disabled

domain = Domain(Domain(7, 14))
plane = Plane(Plane(origin=(47.3684059, -145.6596011, 0), x=(0, 1, 0), y=(1, 0, 0)))
seed_2 = Slider(75, range=0..100)
rectangular = Rectangular(
    Plane=plane,
    SizeX=Slider(10, range=0..100),
    SizeY=Slider(8, range=0..10),
    ExtentX=Slider(3, range=0..100),
    ExtentY=Slider(6, range=0..100))  # -> Cells, Points
random = Random(Range=domain, Number=Slider(2, range=0..10), Seed=Slider(20, range=0..100))  # disabled
unit_z_2 = UnitZ(Factor=Slider(9, range=0..100))
extrude = Extrude(Base=merge, Direction=unit_z_2)
division_amount = Slider(7, range=0..10)
panel_4 = Panel(random)
random_reduce_4 = RandomReduce(List=flatten(rectangular.Cells), Reduction=Slider(9, range=0..10), Seed=seed_2)
floor_height_2 = Slider(10, range=0..100)
graft_tree = GraftTree(Tree=random, IncludeEmptyLists=True, IncludeNullItems=True)  # disabled
extrude_2 = Extrude(Base=random_reduce_4)
unit_z_3 = UnitZ(Factor=graft_tree)  # disabled
unit_z_4 = UnitZ(Factor=floor_height_2)
divide_surfaces = DivideSurfaces(curve=merge, surface=merge, B=division_amount, B_2=division_amount)  # disabled
# Ideas for mergin the unit boxes into larger spaces
# 
# 1: Create a graph structure with unit
# boxes as vertices and whether they are
#  next to each other as edge, then cluster
# the graph into rooms.
# 
# 2. Place points that 'fight' over area
# (Voronoi?) Then square off the areas
# and create the rooms
number_slider_20 = Slider(6, range=0..10)
extrude_3 = Extrude(Base=divide_surfaces, Direction=unit_z_3)  # disabled
move_3 = Move(Geometry=random_reduce_4, Motion=unit_z_4)  # -> Geometry, Transform
random_reduce_5 = RandomReduce(List=flatten(move_3.Geometry), Reduction=number_slider_20, Seed=seed_2)
merge_2 = Merge(Data1=random_reduce_4, Data2=random_reduce_5)
brep_self_intersect = PythonScript(Brep=flatten(extrude_3))  # -> out, result; inputs Brep: list
# ---------- brep_self_intersect: Python ----------
import rhinoscriptsyntax as rs
edgesFound = []
for i, BrepA in enumerate(Brep):
    for j, BrepB in enumerate(Brep):
        if(rs.IntersectBreps(BrepA, BrepB)):
            edgesFound.append((i, j))
edges = dict()
for i in range(len(Brep)):
    edges[i] = set()
for edge in edgesFound:
    edges[edge[0]].add(edge[1])
    edges[edge[1]].add(edge[0])
for i, edge in enumerate(edges):
    edges[edge].discard(i) #Remove own value from own intersection set
result = [edges]
print(edges)
# ---------- end brep_self_intersect ----------
cap_holes = CapHoles(Brep=extrude_3)  # -> flatten(Brep)
number_slider_21 = Slider(3, range=0..20)  # disabled
number_slider_22 = Slider(38, range=0..100)  # disabled
number_slider_23 = Slider(4, range=0..20)  # disabled
number_slider_24 = Slider(53, range=0..100)  # disabled
number_slider_25 = Slider(3, range=0..20)  # disabled
number_slider_26 = Slider(18, range=0..100)  # disabled
number_slider_27 = Slider(3, range=0..20)  # disabled
number_slider_28 = Slider(59, range=0..100)  # disabled
curve_2 = Curve(<curve referenced from the Rhino model>)

# ----
# Intersection Brep | Curve
brep_curve = BrepCurve(Brep=cap_holes, Curve=curve_2)  # -> Curves, Points
list_length_2 = ListLength(List=brep_curve.Curves)
number = Number(1)
smaller_than = SmallerThan(FirstNumber=list_length_2, SecondNumber=number)  # -> flatten(SmallerThan), OrEqualTo
sift_pattern = SiftPattern(List=cap_holes, SiftPattern=smaller_than.SmallerThan)  # -> Output0, Output1

random_path = PythonScript(edges=brep_self_intersect.result, length=number_slider_21, seed=number_slider_22)  # -> out, path, leftover; inputs edges: list; disabled
# ---------- random_path: Python ----------
import random
import copy
random.seed(seed)
i = length #Preferred path length
edgeAdjList = copy.deepcopy(edges[0])
nodeAmount = len(edgeAdjList)

## Creates random path given adjacency list of edges
def createPath(edges, length):
    i = length
    node = random.choice(edges.keys())#Pick initial random node
    path = [] #Resulting path
    path.append(node)
    while(i>0):
        if(len(edges[node])<1):#Check whether node still has edges
            print("Node has no edges")
            break
        newNode = random.sample(edges[node], 1)[0]#Pick random edge of node
        #Remove references to old node
        del edges[node]
        for edge in edges:
            edges[edge].discard(node)
        #Update node and add to path
        node = newNode
        path.append(node)
        i = i-1
    return path

path = createPath(edgeAdjList, i)
leftover = [edgeAdjList]
# ---------- end random_path ----------
list_item_2 = ListItem(List=cap_holes, Index=random_path.path, Wrap=True)  # disabled
colour_swatch = ColourSwatch(SwatchColor=RGB(255, 255, 255))  # disabled
custom_preview = CustomPreview(Geometry=list_item_2, Shader=colour_swatch)  # disabled

random_path_2 = PythonScript(edges=random_path.leftover, length=number_slider_23, seed=number_slider_24)  # -> out, path, leftover; inputs edges: list; disabled; same code as random_path
colour_swatch_2 = ColourSwatch(SwatchColor=RGB(255, 0, 0))  # disabled
list_item_3 = ListItem(List=cap_holes, Index=random_path_2.path, Wrap=True)  # disabled
custom_preview_2 = CustomPreview(Geometry=list_item_3, Shader=colour_swatch_2)  # disabled

random_path_3 = PythonScript(edges=random_path_2.leftover, length=number_slider_25, seed=number_slider_26)  # -> out, path, leftover; inputs edges: list; disabled; same code as random_path
colour_swatch_3 = ColourSwatch(SwatchColor=RGB(245, 237, 12))  # disabled
list_item_4 = ListItem(List=cap_holes, Index=random_path_3.path, Wrap=True)  # disabled
custom_preview_3 = CustomPreview(Geometry=list_item_4, Shader=colour_swatch_3)  # disabled

random_path_4 = PythonScript(edges=random_path_3.leftover, length=number_slider_27, seed=number_slider_28)  # -> out, path, leftover; inputs edges: list; disabled; same code as random_path
colour_swatch_4 = ColourSwatch(SwatchColor=RGB(22, 106, 201))  # disabled
list_item_5 = ListItem(List=cap_holes, Index=random_path_4.path, Wrap=True)  # disabled
custom_preview_4 = CustomPreview(Geometry=list_item_5, Shader=colour_swatch_4)  # disabled

brep = Brep(sift_pattern.Output1)

# ==== cluster DivideSurfaces
curve = ClusterInput()
number = Number(1)
number_2 = Number(0)
B = ClusterInput()
B_2 = ClusterInput()
surface = ClusterInput()

# ----
# Divide surface into equal sized subsurfaces
explode = Explode(Curve=curve, Recursive=True)  # -> Segments, Vertices
list_item = ListItem(List=explode.Segments, Index=number, Wrap=True)
list_item_2 = ListItem(List=explode.Segments, Index=number_2, Wrap=True)
length = Length(Curve=list_item)
length_2 = Length(Curve=list_item_2)
division = Division(A=length_2, B=B)  # -> flatten(Result)
division_2 = Division(A=length, B=B_2)  # -> flatten(Result)
mesh_surface = MeshSurface(Surface=surface, UCount=division, VCount=division_2, Overhang=True, Equalize=False)
face_boundaries = FaceBoundaries(Mesh=mesh_surface)

boundaries = ClusterOutput(face_boundaries)
