# Grasshopper definition P_001.gh (Grasshopper 0.9.56)

polygon = Polygon(Plane=PlaneXY(0, 0, 0), Radius=Slider(50, range=0..100), Segments=Slider(3, range=0..10), FilletRadius=0)  # -> Polygon, Length
construct_point = ConstructPoint(XCoordinate=Slider(10, range=0..10), YCoordinate=Slider(50, range=0..100), ZCoordinate=Slider(15, range=0..100))
construct_point_2 = ConstructPoint(XCoordinate=Slider(0, range=0..10), YCoordinate=Slider(21, range=0..100), ZCoordinate=Slider(44, range=0..100))
explode = Explode(Curve=polygon.Polygon, Recursive=True)  # -> Segments, Vertices
unit_z = UnitZ(Factor=Slider(20, range=0..100))
construct_domain = ConstructDomain(DomainStart=Slider(10, range=0..10), DomainEnd=Slider(50, range=0..100))
polyline = PolyLine(Closed=False)
line = Line(StartPoint=construct_point, EndPoint=construct_point_2)
expression = Expression(x=Slider(60, range=0..100), Expression="sin (x)")
construct_domain_2 = ConstructDomain(DomainStart=Slider(5, range=0..10), DomainEnd=Slider(50, range=0..100))
c_script = CSharpScript()  # -> Out, A
number_slider = Slider(5, range=0..10)
divide_curve = DivideCurve(Curve=line, Count=Slider(4, range=0..10), Kinks=False)  # -> Points, Tangents, Parameters
random = Random(Range=construct_domain, Number=Slider(5, range=0..100), Seed=Slider(40, range=0..50))
list_item = ListItem(List=explode.Segments, Index=Slider(5, range=0..10), Wrap=True)
curve = Curve([<curve referenced from the Rhino model> x5])
unit_z_2 = UnitZ(Factor=random)
evaluate = Evaluate(Expression=expression, x=Slider(5, range=0..10))
expression_2 = Expression(Expression="Format(\"{0}, {1}\", x, y)")
extrude = Extrude(Base=curve, Direction=unit_z_2)
panel = Panel(evaluate)
sine = Sine(Value=Slider(67, range=0..100))
unit_z_3 = UnitZ(Factor=Slider(50, range=0..100))
extrude_2 = Extrude(Base=list_item, Direction=unit_z_3)
panel_2 = Panel(sine)
list_item_2 = ListItem(List=divide_curve.Points, Index=Slider(1, range=0..10), Wrap=True)
center_box = CenterBox(Base=list_item_2, X=Slider(1.2, range=0..100), Y=Slider(4, range=0..100), Z=Slider(3, range=0..100))
