# Grasshopper definition P_002.gh (Grasshopper 0.9.76)
# plug-ins: Python Interpreter

number_slider = Slider(10, range=0..10)  # disabled
number_slider_2 = Slider(0, range=0..10)  # disabled
number_slider_3 = Slider(50, range=0..100)  # disabled
number_slider_4 = Slider(21, range=0..100)  # disabled
number_slider_5 = Slider(15, range=0..100)  # disabled
number_slider_6 = Slider(44, range=0..100)  # disabled
construct_point = ConstructPoint(XCoordinate=number_slider, YCoordinate=number_slider_3, ZCoordinate=number_slider_5)  # disabled
construct_point_2 = ConstructPoint(XCoordinate=number_slider_2, YCoordinate=number_slider_4, ZCoordinate=number_slider_6)  # disabled
number_slider_7 = Slider(4, range=0..10)  # disabled
line = Line(StartPoint=construct_point, EndPoint=construct_point_2)  # disabled
divide_curve = DivideCurve(Curve=line, Count=number_slider_7, Kinks=False)  # -> Points, Tangents, Parameters; disabled
number_slider_8 = Slider(3, range=0..10)  # disabled
number_slider_9 = Slider(5.2, range=0..100)  # disabled
number_slider_10 = Slider(3, range=0..100)  # disabled
number_slider_11 = Slider(4, range=0..100)  # disabled
list_item = ListItem(List=divide_curve.Points, Index=number_slider_8, Wrap=True)  # disabled
center_box = CenterBox(Base=list_item, X=number_slider_9, Y=number_slider_11, Z=number_slider_10)  # disabled

number_slider_12 = Slider(2, range=0..10)  # disabled
number_slider_13 = Slider(6, range=0..10)  # disabled
number_slider_14 = Slider(6, range=0..10)  # disabled
number_slider_15 = Slider(10, range=0..10)  # disabled
center_box_2 = CenterBox(Base=PlaneXY(0, 0, 0), X=number_slider_12, Y=number_slider_12, Z=number_slider_12)  # disabled
number_slider_16 = Slider(200, range=0..1000)  # disabled
box_array = BoxArray(
    Geometry=center_box_2,
    Cell={Plane=PlaneXY(0, 0, 0), X=Domain(0, 10), Y=Domain(0, 5), Z=Domain(0, 2)},
    XCount=number_slider_14,
    YCount=number_slider_13,
    ZCount=number_slider_15)  # -> Geometry, Transform; disabled
list_length = ListLength(List=box_array.Geometry)  # disabled
random_reduce = RandomReduce(List=box_array.Geometry, Reduction=number_slider_16, Seed=1)  # disabled
subtraction = Subtraction(A=list_length, B=number_slider_16)  # disabled
panel = Panel(box_array.Geometry)  # disabled
panel_2 = Panel(subtraction)  # disabled

curve = Curve([<curve referenced from the Rhino model> x15])
unit_z = UnitZ(Factor=Slider(14, range=0..100))
panel_3 = Panel(curve)
extrude = Extrude(Base=curve, Direction=unit_z)
number_slider_17 = Slider(36, range=0..100)
random_reduce_2 = RandomReduce(List=flatten(extrude), Reduction=Slider(7, range=0..10), Seed=number_slider_17)
extrude_2 = Extrude(Base=random_reduce_2, Direction=unit_z)
move = Move(Geometry=extrude_2, Motion=unit_z)  # -> Geometry, Transform
random_reduce_3 = RandomReduce(List=flatten(move.Geometry), Reduction=Slider(4, range=0..10), Seed=number_slider_17)
merge = Merge(Data1=random_reduce_2, Data2=random_reduce_3)

number_slider_18 = Slider(10, range=0..10)  # disabled
number_slider_19 = Slider(5, range=0..10)  # disabled
range = Range(Domain=number_slider_19, Steps=number_slider_18)  # disabled
random = Random(Range=range, Number=1, Seed=2)  # disabled

series = Series(Start=Slider(0, range=0..100), Step=Slider(10, range=0..10), Count=Slider(31, range=0..100))
smaller = SmallerThan(FirstNumber=series, SecondNumber=Slider(41, range=0..100))  # -> SmallerThan, OrEqualTo
python = PythonScript(x=series, y=smaller.SmallerThan)  # -> out, a
# ---------- python: Python ----------
if y:
    a = x
# ---------- end python ----------

Z = UnitZ(Factor=random)  # disabled
panel_4 = Panel(python.out)
graft = GraftTree(Tree=merge, IncludeEmptyLists=True, IncludeNullItems=True)
