# Grasshopper definition P_003.gh (Grasshopper 0.9.56)

extent = Slider(12, range=0..40)

# ---- group: grid properties
extent_2 = Slider(12, range=0..40)
cell = Slider(6.261, range=0..40)

# ---- group: attracter point
pt = Point(graft([<point referenced from the Rhino model> x3]))

# ---- group: radius of affected area
threshold = Slider(33, range=5..60)

# ----
# BE CAREFUL WHEN LOWERING TOO MUCH
slider = Slider(1.522, range=0..40)

point = Point(<point referenced from the Rhino model>)
plane = Plane()
sqgrid = Square(Plane=point, Size=cell, ExtentX=extent, ExtentY=extent_2)  # -> Cells, flatten(Points)
division = Division(A=cell, B=slider)
radius = Number(division)

dist = Distance(PointA=pt, PointB=sqgrid.Points)
division_2 = Division(A=dist, B=threshold)
number_slider = Slider(1, range=0..1)
circle = Circle(Plane=pt, Radius=threshold)
flip = FlipMatrix(Data=division_2)
smaller_than = SmallerThan(FirstNumber=flip, SecondNumber=number_slider)  # -> SmallerThan, OrEqualTo
cull_pattern = CullPattern(List=flip, CullPattern=smaller_than.SmallerThan)
average = Average(Input=cull_pattern)  # -> flatten(ArithmeticMean)
replace_nulls = ReplaceNulls(Items=average, Replacements=number_slider)  # -> Items, Count

# ---- group: graph mapper
graph_mapper = GraphMapper(
    replace_nulls.Items,
    x0=0,
    x1=1,
    y0=0,
    y1=1,
    container_name="Bezier",
    cpx=[0, 0.8067039847, 0.7982004285, 1],
    cpy=[0, 0.1972345114, 1, 1])

# ----
number_slider_2 = Slider(50, range=0..100)
multiplication = Multiplication(A=graph_mapper, B=radius)
center_box = CenterBox(Base=sqgrid.Points, X=multiplication, Y=multiplication, Z=multiplication)

# ---- group: result
circle_2 = CircleCNR(Center=sqgrid.Points, Normal=Vector(0, 0, 1), Radius=multiplication)  # disabled
