# Grasshopper definition P_004.gh (Grasshopper 0.9.76)

extent = Slider(12, range=0..40)

# ---- group: grid properties
extent_2 = Slider(12, range=0..40)
cell = Slider(6.261, range=0..40)

# ---- group: attracter point
pt = Point(graft([<point referenced from the Rhino model> x3]))

# ---- group: radius of affected area
threshold = Slider(38, range=5..60)

# ----
# BE CAREFUL WHEN LOWERING TOO MUCH
slider = Slider(2.383, range=0..40)

line = Line(StartPoint=flatten(pt), EndPoint=pt)
pipe = Pipe(Curve=line, Radius=1, Caps=0)
point = Point(<point referenced from the Rhino model>)
division = Division(A=cell, B=slider)
sqgrid = Square(Plane=point, Size=cell, ExtentX=extent, ExtentY=extent_2)  # -> Cells, flatten(Points)

number_slider = Slider(7, range=0..10)
panel = Panel("floor heights")
unit_z = UnitZ(Factor=number_slider)
move = Move(Geometry=sqgrid.Points, Motion=unit_z)  # -> Geometry, Transform
move_2 = Move(Geometry=move.Geometry, Motion=unit_z)  # -> Geometry, Transform
move_3 = Move(Geometry=move_2.Geometry, Motion=unit_z)  # -> Geometry, Transform
flip_matrix = FlipMatrix(Data=[move_2.Geometry, move.Geometry, move_3.Geometry])  # -> flatten(Data)

sphere = Sphere(Base=pt, Radius=threshold)
radius = Number(division)

unit_z_2 = UnitZ(Factor=number_slider)
multiplication = Multiplication(A=unit_z_2, B=Slider(-1, range=-3..10))
move_4 = Move(Geometry=flip_matrix, Motion=multiplication)  # -> Geometry, Transform

number_slider_2 = Slider(1, range=0..1)
dist = Distance(PointA=pt, PointB=move_4.Geometry)
division_2 = Division(A=dist, B=threshold)
flip = FlipMatrix(Data=division_2)
smaller_than = SmallerThan(FirstNumber=flip, SecondNumber=number_slider_2)  # -> SmallerThan, OrEqualTo
cull_pattern = CullPattern(List=flip, CullPattern=smaller_than.SmallerThan)
average = Average(Input=cull_pattern)  # -> flatten(ArithmeticMean)
replace_nulls = ReplaceNulls(Items=average, Replacements=number_slider_2)  # -> Items, Count

# ---- group: graph mapper
graph_mapper = GraphMapper(
    replace_nulls.Items,
    x0=0,
    x1=1,
    y0=0,
    y1=1,
    container_name="Bezier",
    cpx=[0, 0.8067039847, 0.7982004285, 1],
    cpy=[0, 0.1972345114, 1, 1])

# ----
multiplication_2 = Multiplication(A=graph_mapper, B=radius)
center_box = CenterBox(Base=move_4.Geometry, X=multiplication_2, Y=multiplication_2, Z=multiplication_2)

# ---- group: result
circle = CircleCNR(Normal=Vector(0, 0, 1), Radius=multiplication_2)  # disabled
